# Grasshopper definition main2.gh (Grasshopper 1.0.8)

srf = Surface(<surface referenced from the Rhino model>)
crv = Curve(<curve referenced from the Rhino model>)
py3 = Python3Script(
    curve=crv,
    target_surface=srf,
    count=Slider(72, range=0..100),
    radius=Slider(2.828, range=0..5),
    k_rep=Slider(1.108, range=0..2),
    rest_length=Slider(1, range=0..2),
    k_spring=Slider(0.351, range=0.1..0.8),
    k_smooth=Slider(0.115, range=0.05..0.4),
    reset=Button())  # -> out, out_points, out_curve; inputs curve: Curve, target_surface: Surface, count: Int32, radius: Double, k_rep: Double, rest_length: Double, k_spring: Double, k_smooth: Double, reset: Boolean
# ---------- py3: Python ----------
import Rhino.Geometry as rg

class Node:
    """
    
    """
    def __init__(self, position):
        self.position = position
        self.force = rg.Vector3d(0, 0, 0)

    def reset_force(self,):
        self.force = rg.Vector3d(0, 0, 0)

    def add_force(self, force_vector):
        self.force += force_vector

    def update_position(self ):
        self.position += self.force

class DifferentialGrowth:
    """
    """
    def __init__(self, curve, target_surface=None, count=20, radius=2.0, k_rep=0.5, rest_length=1, k_spring = 0.4, k_smooth = 0.2):
        self.target_surface = target_surface
        self.count = count
        self.radius = radius
        self.k_rep = k_rep
        self.rest_length = rest_length
        self.k_spring = k_spring
        self.k_smooth = k_smooth
        self.is_closed = curve.IsClosed if curve else False

        initial_points = self._resample_curve(curve, count)

        self.nodes = [Node(pt) for pt in initial_points]

        if self.target_surface:
            self.project_to_surface()


    def _resample_curve(self, curve, count):
        if not curve:
            return []

        division_params = curve.DivideByCount(count, True)

        if not division_params:
            return [curve.PointAtStart, curve.PointAtEnd]

        pts = [curve.PointAt(t) for t in division_params]

        return pts

    def project_to_surface(self,):
        if not self.target_surface:
            return

        for node in self.nodes:
            success, u, v = self.target_surface.ClosestPoint(node.position)
            if success:
                node.position = self.target_surface.PointAt(u, v)

    def compute_repulsion(self, ):
        n = len(self.nodes)

        for i in range(n):
            node_a = self.nodes[i]
            for j in range(i + 1, n):
                node_b = self.nodes[j]
                dir_vec = node_a.position - node_b.position
                distance = dir_vec.Length

                if 0 < distance < self.radius:
                    dir_vec.Unitize()
                    strength = (1.0 - (distance / self.radius)) * self.k_rep
                    rep_force = dir_vec * strength
                    node_a.add_force(rep_force)
                    node_b.add_force(-rep_force)

    def compute_spring(self, ):
        n = len(self.nodes)

        if n < 2:
            return
        
        loop_count = n if self.is_closed else n - 1

        for i in range(loop_count):
            node_a = self.nodes[i]
            node_b = self.nodes[(i + 1) % n]
            
            dir_vec = node_b.position - node_a.position
            distance = dir_vec.Length

            if distance > 0:
                delta = distance - self.rest_length
                spring_force = dir_vec - (delta * self.k_spring)

                node_a.add_force(spring_force)
                node_b.add_force(-spring_force)

    def compute_smoothing(self, ):
        n = len(self.nodes)

        if n < 3:
            return

        for i in range(n):
            if not self.is_closed and (i == 0 or i == n - 1):
                continue
            prev_node = self.nodes[(i - 1) % n]
            curr_node = self.nodes[i]
            next_node = self.nodes[(i + 1) % n]

            mid_pt = (prev_node.position + next_node.position) * 0.5
            smooth_vec = mid_pt - curr_node.position
            curr_node.add_force(smooth_vec * self.k_smooth)

    def updates(self, ):
        for node in self.nodes:
            node.update_position()

        if self.target_surface:
            self.project_to_surface()

    def get_points(self, ):
        return [node.position for node in self.nodes]

    def get_curve(self, ):
        pts = self.get_points()

        if len(pts) < 2:
            return None

        if self.is_closed:
            pts.append(pts[0])
        return rg.Curve.CreateControlPointCurve(pts, degree=3)

    

if "solver" not in globals() or reset:
    solver = DifferentialGrowth(curve, target_surface, count, radius, k_rep, rest_length, k_spring, k_smooth)

if solver:
    for node in solver.nodes:
        node.reset_force()

    solver.compute_repulsion()
    solver.updates()
    out_points = solver.get_points()
    out_curve = solver.get_curve()
# ---------- end py3 ----------
